# Grasshopper definition FDM3.gh (Grasshopper 0.9.76)

Y = UnitY(Factor=1)
Y_2 = UnitY(Factor=1)
Y_3 = UnitY(Factor=1)
Y_4 = UnitY(Factor=1)
Y_5 = UnitY(Factor=1)
neg = Negative(Value=Y)
neg_2 = Negative(Value=Y_2)
neg_3 = Negative(Value=Y_3)
neg_4 = Negative(Value=Y_4)
neg_5 = Negative(Value=Y_5)
panel = Panel("""0
1
2
3
4""")
vec = Vector([neg, neg_2, neg_3, neg_4, neg_5])
pt = Point([<point referenced from the Rhino model> x14])
crv = Curve([<curve referenced from the Rhino model> x31])
crv_2 = Curve([<curve referenced from the Rhino model> x2])

Z = UnitZ(Factor=1)
neg_6 = Negative(Value=Z)
neg_7 = Negative(Value=Z)
panel_2 = Panel("""0
1""")
vec_2 = Vector([neg_7, neg_6])
crv_3 = Curve([<curve referenced from the Rhino model> x108])
crv_4 = Curve(<curve referenced from the Rhino model>)
pt_2 = Point([<point referenced from the Rhino model> x28])

Z_2 = UnitZ(Factor=1)
Z_3 = UnitZ(Factor=1)
Z_4 = UnitZ(Factor=1)
Z_5 = UnitZ(Factor=1)
Z_6 = UnitZ(Factor=1)
number_slider = Slider(55, range=0..100)
neg_8 = Negative(Value=[Z_2, Z_3, Z_4, Z_5, Z_6])
panel_3 = Panel("""7
2
3
4
5""")
vec_3 = Vector(neg_8)
pt_3 = Point([<point referenced from the Rhino model> x16])
crv_5 = Curve([<curve referenced from the Rhino model> x26])
crv_6 = Curve([<curve referenced from the Rhino model> x3])

# ----
# Please use this right model so far.
# (number of constraint functions(ConFun) is depend on models.)
number_slider_2 = Slider(0.4, range=0..10)

Y_6 = UnitY(Factor=1)
neg_9 = Negative(Value=Y_6)
crv_7 = Curve(<curve referenced from the Rhino model>)
panel_4 = Panel("3")
pt_4 = Point([<point referenced from the Rhino model> x12])
crv_8 = Curve([<curve referenced from the Rhino model> x27])

points = PointList(Points=pt_4, Size=number_slider_2)
points_2 = PointList(Points=pt, Size=number_slider_2)
points_3 = PointList(Points=pt_2, Size=number_slider_2)
points_4 = PointList(Points=pt_3, Size=number_slider_2)
